# Grasshopper definition graphml_to_GH.gh (Grasshopper 1.0.8)

path = FilePath("C:\Users\CDH\Documents\GitHub\MaCAD25_Thesis\knowledge\urban_graph.graphml")

# ---- group: Loads .graphml
py3 = Python3Script(graphml_path=path, reload_trigger=Button())  # -> out, a, b, c; inputs graphml_path: String, reload_trigger: Boolean
# ---------- py3: Python ----------
# ----------------------------
# Node A: Load GraphML (Reader)
# ----------------------------
import Rhino.Geometry as rg
import networkx as nx
import os

# === Function to load graph ===
def load_graph(graphml_path):
    if not graphml_path or not os.path.exists(graphml_path):
        raise ValueError("GraphML file not found at path: " + str(graphml_path))

    # Load GraphML
    G = nx.read_graphml(graphml_path)
    nodes = []
    node_ids = []
    edges = []

    # Extract nodes and positions
    for node_id, data in G.nodes(data=True):
        try:
            x = float(data.get("x", 0))
            y = float(data.get("y", 0))
        except (ValueError, TypeError):
            x, y = 0.0, 0.0  # fallback if x/y missing
        pt = rg.Point3d(x, y, 0)
        nodes.append(pt)
        node_ids.append(node_id)

    # Extract edges
    for u, v in G.edges():
        u_data = G.nodes[u]
        v_data = G.nodes[v]
        u_pt = rg.Point3d(float(u_data.get("x", 0)), float(u_data.get("y", 0)), 0)
        v_pt = rg.Point3d(float(v_data.get("x", 0)), float(v_data.get("y", 0)), 0)
        edges.append(rg.Line(u_pt, v_pt))

    return nodes, node_ids, edges

# === Inputs ===
# graphml_path: String path to GraphML file (from Panel)
# reload_trigger: Boolean toggle to force reload (from Button)

# === File Change Detection ===
current_mtime = os.path.getmtime(graphml_path) if os.path.exists(graphml_path) else 0

# Store last modification time in the component (static variable)
if not hasattr(load_graph, "last_mtime"):
    load_graph.last_mtime = -1  # initialize

# Reload if file changed OR reload_trigger is True
if reload_trigger or current_mtime != load_graph.last_mtime:
    a, b, c = load_graph(graphml_path)  # Outputs: a = nodes, b = node_ids, c = edges
    load_graph.last_mtime = current_mtime
else:
    # Keep previous outputs if no change
    a, b, c = a, b, c
# ---------- end py3 ----------

# ----
line = Line(py3.c)

pt = Point(py3.a)
pt_2 = Point([Point(240793.1514, 5068155.908, 0), Point(240814.8899, 5068152.987, 0), Point(240874.8611, 5068211.049, 0), Point(240817.6542, 5068277.526, 0), Point(240839.1407, 5068253.117, 0), Point(240857.1572, 5068204.577, 0)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])

# ---- group: Overrides .graphml
py3_2 = Python3Script(updated_points=pt_2, node_ids=py3.b, original_graphml=path, save_path=path, save_trigger=Button())  # -> out, a, b, c; inputs updated_points: list, node_ids: list, original_graphml: String, save_path: String, save_trigger: Boolean
# ---------- py3_2: Python ----------
# ----------------------------
# Node B: Save GraphML (Writer)
# ----------------------------
import networkx as nx
import os
import rhinoscriptsyntax as rs

def save_graph(updated_points, node_ids, original_graphml, save_path):
    # Check inputs
    if not os.path.exists(original_graphml):
        raise ValueError("Original GraphML file not found: " + original_graphml)
    if len(updated_points) != len(node_ids):
        raise ValueError("Number of updated points does not match number of node IDs.")

    # Load original graph
    G = nx.read_graphml(original_graphml)

    # Update node positions
    for pt_ref, node_id in zip(updated_points, node_ids):
        # Convert GUID reference to Point3d
        pt = rs.coerce3dpoint(pt_ref)
        if pt:  # Ensure conversion succeeded
            if node_id in G.nodes:
                G.nodes[node_id]["x"] = pt.X
                G.nodes[node_id]["y"] = pt.Y
        else:
            raise ValueError("Invalid point reference for node: " + str(node_id))

    # Write updated graph
    nx.write_graphml(G, save_path)
    print("GraphML saved successfully to:", save_path)

# Inputs:
# updated_points: List of Point3d or GUIDs (edited in Rhino)
# node_ids: List of node IDs (from Node A)
# original_graphml: Path to original .graphml
# save_path: Path to save updated .graphml
# save_trigger: Boolean button to trigger save

if save_trigger:
    save_graph(updated_points, node_ids, original_graphml, save_path)
# ---------- end py3_2 ----------
